test file "TestManager"
  coverage: Decision

suite "TestSuite"

  case "NormalBehaviourIterations" [baseline]
    model deliverable_2, harness Normal_Behaviour (for deliverable_2/Chart)
    test sequence scenario: Test1_Power (Normal_Behaviour/Test Sequence)
    iterations:
      Iteration1: TestSequenceScenario "Test1_Power"
      Iteration2: TestSequenceScenario "Test2_PotPresence"
      Iteration3: TestSequenceScenario "Test3_Cooking300W"
      Iteration4: TestSequenceScenario "Test4_Cooking500W"
      Iteration5: TestSequenceScenario "Test5_Cooking1500W"

  case "AtypicalBehaviourIteration" [baseline]
    model deliverable_2, harness Atypical_Behaviour (for deliverable_2/Chart)
    test sequence scenario: Test1_SenzaPentola (Atypical_Behaviour/Test Sequence)
    iterations:
      Iteration1: TestSequenceScenario "Test1_SenzaPentola"
      Iteration2: TestSequenceScenario "Test2_PotenzaAnomala_RimozionePentola"
      Iteration3: TestSequenceScenario "Test3_RimozionePentolaInWaiting"
      Iteration4: TestSequenceScenario "Test4_ComeToPower1"
      Iteration5: TestSequenceScenario "Test5_ComeToPower2"